# Dynamo graph ParkingLayoutTest.dyn (Dynamo 1.2.1.3083)

family_types = FamilyTypes("SC-Parking-Car_Space:5400 x 2400 - Residential")
code_block = CodeBlock { Point.ByCoordinates(0,0,0); }
integer_slider = IntegerSlider(5, range=0..100 step 1)
integer_slider_2 = IntegerSlider(10, range=0..100 step 1)
boolean = BoolSelector(true)
byLocation = ParkingLayout.ByLocation(code_block, arg5=integer_slider, arg6=integer_slider_2, arg7=boolean)
code_block_2 = CodeBlock { 0; }
setLayoutRotation = ParkingLayout.SetLayoutRotation(byLocation, code_block_2)
placeFamily = Custom[PlaceFamily](familyType=family_types, ParkingLayout=setLayoutRotation)
watch = Watch(placeFamily.numberOfCars)
