# Dynamo graph SightLinesTest.dyn (Dynamo 1.2.1.3083)

integer_slider = IntegerSlider(13, range=1..36 step 1)
code_block = CodeBlock { 6000; }
byValues = SCDynamoNodes.SightLines.SightLines.ByValues(arg5=integer_slider, arg6=code_block)
profileGeometry = SCDynamoNodes.SightLines.SightLines.ProfileGeometry(byValues)
select_model_element = DSModelElementSelection()  # 1 picked in the model
curve = CurveElement.Curve(select_model_element)
code_block_2 = CodeBlock { 0; }
coordinateSystemAtParameter = Curve.CoordinateSystemAtParameter(curve, code_block_2)
origin = CoordinateSystem.Origin(coordinateSystemAtParameter)
YAxis = CoordinateSystem.YAxis(coordinateSystemAtParameter)
code_block_3 = CodeBlock { 180; }
rotate = CoordinateSystem.Rotate(coordinateSystem=coordinateSystemAtParameter, origin=origin, axis=YAxis, degrees=code_block_3)
transform = Geometry.Transform(profileGeometry, rotate)
bySweep = Surface.BySweep(transform, curve)
integer_slider_2 = IntegerSlider(19, range=1..36 step 1)
treadSize = SCDynamoNodes.SightLines.SightLines.TreadSize(byValues)
numberOfRows = SCDynamoNodes.SightLines.SightLines.NumberOfRows(byValues)
code_block_4 = CodeBlock(x=treadSize, y=numberOfRows, a=code_block) { x*y + a; }
rows = SCDynamoNodes.SightLines.SightLines.Rows(byValues)
code_block_5 = CodeBlock(f=rows, x=numberOfRows) { f[x-1]; }
heightToFocus = SCDynamoNodes.SightLines.SightLinesRow.HeightToFocus(code_block_5)
code_block_6 = CodeBlock(x=heightToFocus) { x + 0; }
byValues_2 = SCDynamoNodes.SightLines.SightLines.ByValues(arg5=integer_slider_2, arg6=code_block_4, arg7=code_block_6)
profileGeometry_2 = SCDynamoNodes.SightLines.SightLines.ProfileGeometry(byValues_2)
transform_2 = Geometry.Transform(profileGeometry_2, rotate)
bySweep_2 = Surface.BySweep(transform_2, curve)
watch = Watch(numberOfRows)
